# Dynamo graph DynaShape.ZeroTouch.Goals.AnchorGoal.Change.dyn (Dynamo 3.0.4.7905)
# packages: DynaShape 0.9.0.0

# group: Positions
# Where the anchor will start and where the anchor will rest
number = DoubleInput(12)
byCoordinates = Point.ByCoordinates(x=number, y=number)
byCoordinates_2 = Point.ByCoordinates()

watch_3d = Watch3D(byCoordinates, byCoordinates_2)
create = DynaShape.ZeroTouch.Goals.AnchorGoal.Create(startPosition=byCoordinates, anchor=byCoordinates_2)
number_slider = DoubleSlider(1, range=0..100 step 0.1)

# group: Modify
# modify the anchor goal's anchor point
byCoordinates_3 = Point.ByCoordinates(z=number_slider)
change = DynaShape.ZeroTouch.Goals.AnchorGoal.Change(goal=create, anchor=byCoordinates_3)
