# Dynamo graph DynaShape.ZeroTouch.Goals.AnchorGoal.Create.dyn (Dynamo 3.0.4.7905)
# packages: DynaShape 0.9.0.0

# group: Positions
# Where the anchor will start and where the anchor will rest
number = DoubleInput(12)
byCoordinates = Point.ByCoordinates(x=number, y=number)
byCoordinates_2 = Point.ByCoordinates()

create = DynaShape.ZeroTouch.Goals.AnchorGoal.Create(startPosition=byCoordinates, anchor=byCoordinates_2)
watch_3d = Watch3D(byCoordinates, byCoordinates_2)
