# Dynamo graph DynaShape.ZeroTouch.Goals.AngleGoal.Create.dyn (Dynamo 3.0.4.7905)
# packages: DynaShape 0.9.0.0

# group: Positions
# Generate the 3 positions to create an angle from
byCoordinates = Point.ByCoordinates()
number = DoubleInput(3)
byCoordinates_2 = Point.ByCoordinates(x=number)
number_2 = DoubleInput(3)
byCoordinates_3 = Point.ByCoordinates(x=number_2, y=number_2)

# group: Preview
# Preview the angle to be maintained
list_create = List.Create(item0=byCoordinates, item1=byCoordinates_2, item2=byCoordinates_3)
byPoints = PolyCurve.ByPoints(points=list_create)

watch_3d = Watch3D(byCoordinates, byCoordinates_2, byCoordinates_3, byPoints)

# group: AngleGoal
# Created DynaShape AngleGoal
create = DynaShape.ZeroTouch.Goals.AngleGoal.Create(a=byCoordinates, b=byCoordinates_2, c=byCoordinates_3)
